# Grasshopper definition Hops For Triangular_Pattern.gh (Grasshopper 1.0.7)
# plug-ins: Hops

local = Panel("C:\Users\Ara Keuroghlian\Desktop\Triangular_Pattern.gh")
pt = ConstructPoint(XCoordinate=0, YCoordinate=0, ZCoordinate=0)
hops = Hops(
    _Path=local,
    EnterAPoint=pt,
    PolygonRadius=Slider(5, range=0..10),
    NumberOfSegments=Slider(5, range=0..100),
    ParametersForYAxis=Slider(0.3, range=0..1),
    MotionForYAxis=Slider(0.1, range=0..0.1),
    PolygonDivision=Slider(6, range=0..10),
    CacheResultsInMemory=True,
    CacheSolveResults=True,
    RemoteDefinitionLocation="C:\Users\Ara Keuroghlian\Desktop\Triangular_Pattern.gh",
    RemoteSolveVersion=(0, 1, 0),
    ShowInput_Enabled=False,
    ShowInput_Path=True,
    SynchronousSolve=False)
panel = Panel(hops)
