# Grasshopper definition Triangular_Pattern.gh (Grasshopper 1.0.7)

pt = ConstructPoint(XCoordinate=0, YCoordinate=0, ZCoordinate=0)
enter_a_point = GetPoint(pt, AtLeast=1, AtMost=1, Realtime=True)
polygon_radius = GetNumber(Slider(28, range=0..30), AtLeast=1, AtMost=1, Maximum=30, Minimum=1, Prompt="Set Polygon Radius between 1-30")
number_of_segments = GetInteger(Slider(3, range=3..10), AtLeast=1, AtMost=1, Maximum=10, Minimum=3, Prompt="Set Segments between 1-10")
motion_for_y_axis = GetNumber(Slider(0.504, range=-3..3), AtLeast=1, AtMost=1, Maximum=3, Minimum=-3, Prompt="Set Motion in Y Axis -3...+3")
polygon = Polygon(Plane=enter_a_point, Radius=polygon_radius, Segments=number_of_segments, FilletRadius=0)  # -> Polygon, Length
explode = Explode(Curve=polygon.Polygon, Recursive=True)  # -> Segments, Vertices
parameters_for_y_axis = GetNumber(Slider(0.4, range=0..1), AtLeast=1, AtMost=1, Maximum=1, Minimum=0.1, Prompt="Set Parameters for Y between 0.1....1")
list_item = ListItem(List=explode.Segments, Index=0, Wrap=True)
perp_frame = PerpFrame(Curve=reparameterize(explode.Segments), Parameter=parameters_for_y_axis)
number = Number(list_item)
deconstruct_plane = DeconstructPlane(Plane=perp_frame)  # -> Origin, XAxis, YAxis, ZAxis
circle = Circle(Plane=explode.Vertices, Radius=number)
multiplication = Multiplication(A=deconstruct_plane.YAxis, B=motion_for_y_axis)
end_points = EndPoints(Curve=explode.Segments)  # -> graft(Start), graft(End)
move = Move(Geometry=deconstruct_plane.Origin, Motion=multiplication)  # -> graft(Geometry), Transform
polygon_division = GetNumber(Slider(12, range=1..28), AtLeast=1, AtMost=1, Maximum=28, Minimum=1, Prompt="Divide Curve between 1 & 28")
arc_3pt = Arc3Pt(PointA=end_points.Start, PointB=move.Geometry, PointC=end_points.End)  # -> Arc, Plane, Radius
divide_curve = DivideCurve(Curve=arc_3pt.Arc, Count=polygon_division, Kinks=False)  # -> simplify(Points), Tangents, Parameters
relative_item = RelativeItem(Tree=divide_curve.Points, Offset="{+1}", WrapPaths=True, WrapItems=True)  # -> ItemA, ItemB
line = Line(StartPoint=relative_item.ItemA, EndPoint=relative_item.ItemB)
pipe = Pipe(Curve=line, Radius=Slider(0.1, range=0.1..10), Caps=0)
subd = SubD(pipe)
context_bake = ContextBake(Geometry=subd)
